# Dynamo graph CreateAlignment.dyn (Dynamo 2.3.1.11775)
# packages: Data-Shapes 2021.2.91, Clockwork for Dynamo 2.x 2.3.0

code_block = CodeBlock { "Placement Point?"; }  # frozen
filepath_data = Custom[FilePath Data]()  # package Data-Shapes; Create filepath input for UI.MultipleInputForm ++ . Check out www.data-shapes.net for more infos !
code_block_2 = CodeBlock { "Alignment \nSheet Name"; }
string = StringInput("Alignment")
textbox_data = Custom[TextBox Data](InputName=code_block_2, DefaultText=string)  # package Data-Shapes; Create Data for TextBox input in UI.MultipleInputForm ++ . Check out www.data-shapes.net for more informations
code_block_3 = CodeBlock { "General Points \nSheet Name"; }
string_2 = StringInput("General")
textbox_data_2 = Custom[TextBox Data](InputName=code_block_3, DefaultText=string_2)
code_block_4 = CodeBlock { "Optional Points \nSheet Name"; }
string_3 = StringInput("Optional")
textbox_data_3 = Custom[TextBox Data](InputName=code_block_4, DefaultText=string_3)
code_block_5 = CodeBlock { "Vertical Curve \nSetting"; }
string_4 = StringInput("Vertical Curve")
textbox_data_4 = Custom[TextBox Data](InputName=code_block_5, DefaultText=string_4)
join = List.Join(list0=filepath_data, list1=textbox_data, list2=textbox_data_2, list3=textbox_data_3, list4=textbox_data_4)
boolean = BoolSelector(true)
code_block_6 = CodeBlock { 500; }
multipleinputform = Custom[MultipleInputForm ++](Inputs=join, Toggle=boolean, Width_optional=code_block_6)  # package Data-Shapes; Create a form with multiple inputs. see www.data-shapes.net for tutorials and infos!
firstItem = List.FirstItem(list=multipleinputform.User_Inputs)
file_from_path = FileObject(path=firstItem)
code_block_7 = CodeBlock(sheetname=multipleinputform.User_Inputs) { sheetname[1]; sheetname[2]; sheetname[3]; sheetname[4]; }
importExcel = Data.ImportExcel(file=file_from_path, sheetName=code_block_7.out1)
firstItem_2 = List.FirstItem(list=importExcel)
code_block_8 = CodeBlock(data=importExcel) { List.AllIndicesOf(List.FirstItem(data),"SubPoint")+1; }
getItemAtIndex = List.GetItemAtIndex(list=firstItem_2, index=code_block_8)
dropdown_data = Custom[DropDown Data](InputName=code_block, Keys=getItemAtIndex, Values=code_block_8)  # package Data-Shapes; Create data for DropDown input in UI.MultiInputForm ++ . Check out www.data-shapes.net for more infos.
importExcel_2 = Data.ImportExcel(file=file_from_path, sheetName=code_block_7.out0)
restOfItems = List.RestOfItems(list=importExcel_2)
transpose = List.Transpose(lists=restOfItems)
restOfItems_2 = List.RestOfItems(list=transpose)
code_block_9 = CodeBlock(data=restOfItems_2)
# ---------- code_block_9.designscript (4 lines) ----------
Point.ByCoordinates(data[0],data[1],0);
Vector.Normalized(Vector.ByCoordinates(data[2],data[3],0));
station = data[4];
dist = data[5];
# ----------------------------------------
importExcel_3 = Data.ImportExcel(file=file_from_path, sheetName=code_block_7.out2)
code_block_10 = CodeBlock(data=importExcel_3) { List.AllIndicesOf(List.FirstItem(data),"SubPoint")+1; }
lastItem = List.LastItem(list=code_block_10)
isNull = Object.IsNull(obj=lastItem)
code_block_11 = CodeBlock { "Optional Items"; }
firstItem_3 = List.FirstItem(list=importExcel_3)
getItemAtIndex_2 = List.GetItemAtIndex(list=firstItem_3, index=code_block_10)
code_block_12 = CodeBlock { "Extend Innder"; }
code_block_13 = CodeBlock { "Extend Outer"; }
join_2 = List.Join(list0=getItemAtIndex_2, list1=code_block_12, list2=code_block_13)
code_block_14 = CodeBlock(data=code_block_10, nodata=isNull) { last=List.LastItem(data); nodata?[0,1]:List.Flatten(List.AddItemToEnd([last+1,last+2],data)); }
listview_data = Custom[Listview Data](InputName=code_block_11, Keys=join_2, Values=code_block_14.out1)  # package Data-Shapes; Create data for ListView input in UI.MultiInputForm ++ . Check out www.data-shapes.net for more infos.
code_block_15 = CodeBlock { "Inner Side Extension Length"; }
boolean_2 = BoolSelector(true)
textbox_data_5 = Custom[TextBox Data](InputName=code_block_15, IsNumberEntry=boolean_2)
code_block_16 = CodeBlock { "Outer Side Extension Length"; }
textbox_data_6 = Custom[TextBox Data](InputName=code_block_16, IsNumberEntry=boolean_2)
join_3 = List.Join(list0=listview_data, list1=textbox_data_5, list2=textbox_data_6)
code_block_17 = CodeBlock { "Inner Edge?"; }
dropdown_data_2 = Custom[DropDown Data](InputName=code_block_17, Keys=getItemAtIndex, Values=code_block_8)
code_block_18 = CodeBlock { "Outer Edge?"; }
dropdown_data_3 = Custom[DropDown Data](InputName=code_block_18, Keys=getItemAtIndex, Values=code_block_8)
join_4 = List.Join(list0=dropdown_data_2, list1=dropdown_data_3)
multipleinputform_2 = Custom[MultipleInputForm ++](Inputs=join_4, Toggle=multipleinputform.Was_Run)
multipleinputform_3 = Custom[MultipleInputForm ++](Inputs=join_3, Toggle=multipleinputform_2.Was_Run)
restOfItems_3 = List.RestOfItems(list=multipleinputform_3.User_Inputs)
restOfItems_4 = List.RestOfItems(list=importExcel_3)
transpose_2 = List.Transpose(lists=restOfItems_4)
firstItem_4 = List.FirstItem(list=multipleinputform_3.User_Inputs)
getItemAtIndex_3 = List.GetItemAtIndex(list=transpose_2, index=firstItem_4)
code_block_19 = CodeBlock(noOptional=isNull, extension=restOfItems_3, importData=getItemAtIndex_3) { noOptional?extension:importData; }
scale = Vector.Scale(vector=code_block_9.out1, scale_factor=code_block_19@L2)  # frozen
add = Point.Add(point=code_block_9.out0, vectorToAdd=scale@L2)
importExcel_4 = Data.ImportExcel(file=file_from_path, sheetName=code_block_7.out3)
restOfItems_5 = List.RestOfItems(list=importExcel_4)
transpose_3 = List.Transpose(lists=restOfItems_5)

# group: Calculate elevation and slope
python_script = Python(IN[0]=transpose_3, IN[1]=code_block_9.station)
# ---------- python_script.python (128 lines) ----------
# Load the Python Standard and DesignScript Libraries
import sys
import clr
clr.AddReference('ProtoGeometry')
from Autodesk.DesignScript.Geometry import *

# The inputs to this node will be stored as a list in the IN variables.
dataEnteringNode = IN
data = IN[0]

for index, item in enumerate(data[1]):
    if data[1][index] == data[1][index+1]:
        range=index+1
        break

# Place your code below this line
length = data[0][0:range]
pviElevation = data[1][0:range]
pviStation = data[2][0:range]
slope = data[3][0:range]
superElevationStation = data[4]
superElevation = data[5]

_stationStart =superElevationStation[0]
_stationEnd = superElevationStation[-1]
_CurveType = []
_CurveLength = []

target = [(item*0.001) + _stationStart for item in IN[1]]

def accumulate(list):
    total = 0
    for x in list:
        total += x
        yield total
            

def RangeTypeAtStation(stations, curvelength, accumulationrequired=True):
    group = []
    if accumulationrequired:
        accumulatedLength = list(accumulate(curvelength))
        accumulatedLength.insert(0, 0)
        accumulatedStation = [length + _stationStart for length in accumulatedLength]
    else:
        accumulatedStation = curvelength
#    return accumulatedStation

    for station in stations:
        for index, acs in enumerate(accumulatedStation):
            if accumulatedStation[index] <= station < accumulatedStation[index + 1]:
                group.append(index)
    return group
    
def ElevationAtStation(group, stations, curvetype, curvelength, pvielevation, slope):
    result = []
    accumulatedLength = list(accumulate(curvelength))
    accumulatedLength.insert(0, 0)
    accumulatedStation = [length + _stationStart for length in accumulatedLength]
    for g, st in zip(group, stations):
        # Station on Curve
        if curvetype[g] == "Curve":
            g1 = slope[g - 1] * 0.01
            g2 = slope[g + 1] * 0.01
            cl = curvelength[g]
            g1Elevation = pvielevation[g] - ((cl / 2) * g1)
            xDist = st - accumulatedStation[g]
            yDist = (g1Elevation + (g1 * xDist) + (((g2 - g1) * (xDist * xDist)) / (2 * cl)))
            result.append(yDist)
        # Station on Line
        elif curvetype[g] == "Line":
            if g == 0:
                g1 = slope[g] * 0.01
                g1Elevation = pvielevation[g + 1] - (g1 * (curvelength[g + 1] / 2))
                xDist = accumulatedStation[g + 1] - st
                yDist = g1Elevation - (g1 * xDist)
                result.append(yDist)
            # This Line is not last one.
            elif g < max(group):
                g1 = slope[g] * 0.01
                g1Elevation = pvielevation[g + 1] - (g1 * (curvelength[g + 1] / 2))
                xDist = accumulatedStation[g + 1] - st
                yDist = g1Elevation - (g1 * xDist)
                result.append(yDist)
            # This Line is the last one.
            else:
                g1 = slope[g] * 0.01
                g1Elevation = pvielevation[g - 1] + (g1 * (curvelength[g - 1] / 2))
                xDist = st - accumulatedStation[g]
                yDist = g1Elevation + (g1 * xDist)
                result.append(yDist)
    return result

def SuperElevationAtStation(stations, slopeatmark, stationatmark):
    slopes = []
    superElevationGroup = RangeTypeAtStation(stations, stationatmark, False)
    for station, seg in zip(stations, superElevationGroup):
        slopes.append(
            slopeatmark[seg] + (
                (slopeatmark[seg + 1] - slopeatmark[seg])
                / (stationatmark[seg + 1] - stationatmark[seg])
                * (station - stationatmark[seg])
            )
        )
    return slopes


for index, (sl, c_len) in enumerate(zip(slope, length)):
    if sl is not None:
        _CurveType.append("Line")
    else:
        _CurveType.append("Curve")

for index, (ct, cl) in enumerate(zip(_CurveType, length)):
    if index == 0:
        _CurveLength.append((pviStation[index + 1] - (length[index + 1] / 2)) - _stationStart)
    elif ct == "Curve":
	    _CurveLength.append(cl)
    elif ct == "Line":
	    if index == len(length) - 1:
	        _CurveLength.append(_stationEnd - (pviStation[index - 1] + (length[index - 1] / 2)))
	    else:
	        _CurveLength.append((pviStation[index + 1] - (length[index + 1] / 2)) - (pviStation[index - 1] + (length[index - 1] / 2)))
group = RangeTypeAtStation(target, _CurveLength)
ydisp = ElevationAtStation(group, target, _CurveType, _CurveLength, pviElevation, slope)
se = SuperElevationAtStation(target,superElevation , superElevationStation)

# Assign your output to the OUT variable.
OUT = ydisp, se
# ----------------------------------------

code_block_20 = CodeBlock(result=python_script) { result[0]; result[1]; }
watch = Watch(code_block_20.out0)
code_block_21 = CodeBlock(elev=watch) { elev*1000; }
watch_2 = Watch(code_block_20.out1)
restOfItems_6 = List.RestOfItems(list=importExcel)
transpose_4 = List.Transpose(lists=restOfItems_6)
getItemAtIndex_4 = List.GetItemAtIndex(list=transpose_4, index=multipleinputform_2.User_Inputs)
code_block_22 = CodeBlock(data=getItemAtIndex_4)
# ---------- code_block_22.designscript (6 lines) ----------
data[0];
//placement;
data[0];
//inner;
data[1];
//outer;
# ----------------------------------------
flatten = List.Flatten(list=code_block_22.out1)

# group: Inner Point
code_block_23 = CodeBlock(slope=watch_2, xdist=flatten) { (slope*xdist)/100; }
code_block_24 = CodeBlock(elev=code_block_21, ydisp=code_block_23) { elev+ydisp; }

code_block_25 = CodeBlock(placement=add, level=code_block_24) { Point.ByCoordinates(placement.X,placement.Y,level); }
scale_2 = Vector.Scale(vector=code_block_9.out1, scale_factor=flatten)
add_2 = Point.Add(point=code_block_9.out0, vectorToAdd=scale_2)
code_block_26 = CodeBlock(placement=add_2, level=code_block_24) { Point.ByCoordinates(placement.X,placement.Y,level); }
byPoint = ReferencePoint.ByPoint(pt=code_block_26)
isNull_2 = Object.IsNull(obj=code_block_22.out2@L2)
flatten_2 = List.Flatten(list=isNull_2)
filterByBoolMask = List.FilterByBoolMask(list=code_block_9.out0, mask=flatten_2)
filterByBoolMask_2 = List.FilterByBoolMask(list=code_block_9.out1, mask=flatten_2)
boolean_3 = BoolSelector(false)
clean = List.Clean(list=code_block_22.out2, preserveIndices=boolean_3)
flatten_3 = List.Flatten(list=clean)
scale_3 = Vector.Scale(vector=filterByBoolMask_2.out, scale_factor=flatten_3)
add_3 = Point.Add(point=filterByBoolMask.out, vectorToAdd=scale_3)

# group: Outer Point
filterByBoolMask_3 = List.FilterByBoolMask(list=code_block_21, mask=flatten_2)
filterByBoolMask_4 = List.FilterByBoolMask(list=watch_2, mask=flatten_2)
code_block_27 = CodeBlock(slope=filterByBoolMask_4.out, xdist=flatten_3) { (slope*xdist)/100; }
code_block_28 = CodeBlock(elev=filterByBoolMask_3.out, ydisp=code_block_27) { elev+ydisp; }

code_block_29 = CodeBlock(placement=add_3, level=code_block_28) { Point.ByCoordinates(placement.X,placement.Y,level); }
byPoint_2 = ReferencePoint.ByPoint(pt=code_block_29)
list_create = List.Create(item0=code_block_26, item1=code_block_29)
byStartPointEndPoint = Line.ByStartPointEndPoint(startPoint=code_block_26, endPoint=code_block_29)
firstItem_5 = List.FirstItem(list=code_block_19)
extendStart = Curve.ExtendStart(curve=byStartPointEndPoint, distance=firstItem_5)
lastItem_2 = List.LastItem(list=code_block_19)
extendEnd = Curve.ExtendEnd(curve=extendStart, distance=lastItem_2)
startPoint = Curve.StartPoint(curve=extendEnd)
endPoint = Curve.EndPoint(curve=extendEnd)
list_create_2 = List.Create(item0=startPoint, item1=endPoint)
join_5 = List.Join(list0=list_create, list1=list_create_2)
code_block_30 = CodeBlock { "Select point to create reference line\ninner to outer direction"; }
code_block_31 = CodeBlock { "Start Point"; "End Point"; }
getItemAtIndex_5 = List.GetItemAtIndex(list=firstItem_2, index=multipleinputform_2.User_Inputs)
code_block_32 = CodeBlock(set1=code_block_12, set2=code_block_13) { [set1,set2]; }
getItemAtIndex_6 = List.GetItemAtIndex(list=firstItem_3, index=firstItem_4)
code_block_33 = CodeBlock(noOptional=isNull, extension=code_block_32, importData=getItemAtIndex_6) { noOptional?extension:importData; }
join_6 = List.Join(list0=getItemAtIndex_5, list1=code_block_33)
code_block_34 = CodeBlock(list=join_6) { 0..List.Count(list)-1; }
dropdown_data_4 = Custom[DropDown Data](InputName=code_block_31.out0, Keys=join_6, Values=code_block_34)
dropdown_data_5 = Custom[DropDown Data](InputName=code_block_31.out1, Keys=join_6, Values=code_block_34)
join_7 = List.Join(list0=dropdown_data_4, list1=dropdown_data_5)
multipleinputform_4 = Custom[MultipleInputForm ++](Description_optional=code_block_30, Inputs=join_7, Toggle=multipleinputform_3.Was_Run)
getItemAtIndex_7 = List.GetItemAtIndex(list=join_5, index=multipleinputform_4.User_Inputs)
firstItem_6 = List.FirstItem(list=getItemAtIndex_7)
lastItem_3 = List.LastItem(list=getItemAtIndex_7)
byStartPointEndPoint_2 = Line.ByStartPointEndPoint(startPoint=firstItem_6, endPoint=lastItem_3)
byCurve = ModelCurve.ByCurve(curve=byStartPointEndPoint_2)
code_block_35 = CodeBlock(dist=code_block_9.dist) { dist<50?true:false; }
code_block_36 = CodeBlock { true; }
allIndicesOf = List.AllIndicesOf(list=code_block_35, item=code_block_36)
removeItemAtIndex = List.RemoveItemAtIndex(list=byPoint, indices=allIndicesOf)
boolean_4 = BoolSelector(false)
byReferencePoints = CurveByPoints.ByReferencePoints(points=removeItemAtIndex, isReferenceLine=boolean_4)
list_create_3 = List.Create(item0=byReferencePoints)
byPoints = NurbsCurve.ByPoints(points=code_block_26)
parameterAtPoint = Curve.ParameterAtPoint(curve=byPoints, point=code_block_26)
tangentAtParameter = Curve.TangentAtParameter(curve=byPoints, param=parameterAtPoint)
code_block_37 = CodeBlock { 100; }
scale_4 = Vector.Scale(vector=tangentAtParameter, scale_factor=code_block_37)
cross = Vector.Cross(vector=tangentAtParameter, cross=code_block_9.out1)
code_block_38 = CodeBlock { 50; }
scale_5 = Vector.Scale(vector=cross, scale_factor=code_block_38)
byOriginVectors = Ellipse.ByOriginVectors(origin=code_block_26, xAxisRadius=scale_4, yAxisRadius=scale_5)
byCurve_2 = ModelCurve.ByCurve(curve=byOriginVectors)
code_block_39 = CodeBlock(lines=byStartPointEndPoint_2) { List.DropItems(List.Sublists(List.Flatten(lines),0..1,1),-1); }
byLoft = Surface.ByLoft(crossSections=code_block_39)
flatten_4 = List.Flatten(list=byLoft)
byGeometries = ImportInstance.ByGeometries(geometries=flatten_4)
list_create_4 = List.Create(item0=byGeometries)
list_create_5 = List.Create(item0=byPoint, item1=byPoint_2, item2=byCurve, item3=list_create_3, item4=byCurve_2, item5=list_create_4)
code_block_40 = CodeBlock { "Visible"; }
code_block_41 = CodeBlock(name=getItemAtIndex_5) { name; ["Reference Line","Placement Curve","Plane Normal Line", "Surfaces"]; }
join_8 = List.Join(list0=code_block_41.name, list1=code_block_41.out1)
code_block_42 = CodeBlock { "Family parameter"; "YesNo"; "PG_VISIBILITY"; true; }
python_script_2 = Python(IN[0]=join_8, IN[1]=code_block_42.out1, IN[2]=code_block_42.out2, IN[3]=code_block_42.out3)  # unwired: IN[4], IN[5], IN[6]
# ---------- python_script_2.python (50 lines) ----------
#Alban de Chasteigner 2020
#twitter : @geniusloci_bim
#geniusloci.bim@gmail.com

import clr
clr.AddReference('RevitAPI')
import Autodesk
from Autodesk.Revit.DB import *

clr.AddReference("RevitServices")
import RevitServices
from RevitServices.Persistence import DocumentManager
from RevitServices.Transactions import TransactionManager
doc = DocumentManager.Instance.CurrentDBDocument

paramName = IN[0]
parameterType = IN[1]
parameterGroup = IN[2]
instance = IN[3]
reporting = IN[4]
dimension = UnwrapElement(IN[5])
famParameter = UnwrapElement(IN[6])

TransactionManager.Instance.EnsureInTransaction(doc)
if famParameter == None:
	if isinstance(parameterGroup, basestring):
		exec("paramGroup = BuiltInParameterGroup.%s" % parameterGroup)
	else:
		paramGroup = parameterGroup
	
	if isinstance(parameterType, basestring):
		exec("paramType = ParameterType.%s" % parameterType)
	else :
		paramType = parameterType
	for name in paramName:
		try:
			familyParam = doc.FamilyManager.AddParameter(name, paramGroup, paramType, instance)
		except:
			True
	if reporting == True:
		doc.FamilyManager.MakeReporting(familyParam)
else:
	familyParam = famParameter

if dimension :
	dimension.FamilyLabel = familyParam
else:
	pass
TransactionManager.Instance.TransactionTaskDone()	
OUT = familyParam.Definition.Name
# ----------------------------------------
passthrough = Custom[Passthrough](passThrough=code_block_40, waitFor=python_script_2)  # package Clockwork for Dynamo 2.x; Forces a sequential order of execution. The node wired into the output of the Passthrough node will be executed *after* the node wired into the waitFor input (e.g. important for some Revit operations). The value of the passThrough input will be passed on to the node wired into the output port of the Passthrough node.
python_script_3 = Python(IN[0]=list_create_5, IN[1]=passthrough, IN[2]=join_8)
# ---------- python_script_3.python (66 lines) ----------
import clr
clr.AddReference('RevitAPI')
from Autodesk.Revit.DB import *

clr.AddReference('RevitNodes')

import Revit
clr.ImportExtensions(Revit.GeometryConversion)
clr.ImportExtensions(Revit.Elements)

clr.AddReference('RevitServices')
from RevitServices.Persistence import DocumentManager
from RevitServices.Transactions import TransactionManager

doc = DocumentManager.Instance.CurrentDBDocument


elements_set = IN[0]
epSearch = IN[1]
fpSearch_set = IN[2]

	
for elements, fpSearch in zip(elements_set, fpSearch_set):
	if not isinstance(elements, list):
		elements = [elements]
	if not isinstance(epSearch, list):
		epSearch = [epSearch]
	if not isinstance(fpSearch, list):
		fpSearch = [fpSearch]
	for e in elements:
		e = UnwrapElement(e)
		elemParams = e.Parameters
	
		epNames = []
		fpNames = []
		elemAssoc = []
		famAssoc = []
		
		for ep in elemParams:
			epNames.append(ep.Definition.Name)
			
		epDict = dict(zip(epNames,elemParams))
		elemAssoc = [epDict.get(ep, "none") for ep in epSearch]
		
		famParams = doc.FamilyManager.Parameters
		
		for fp in famParams:
			fpNames.append(fp.Definition.Name)
			
		fpDict = dict(zip(fpNames,famParams))
		famAssoc = [fpDict.get(fp,"none") for fp in fpSearch]
		
	
		TransactionManager.Instance.EnsureInTransaction(doc)
		
		for i,j in zip(elemAssoc,famAssoc):
			try:
				doc.FamilyManager.AssociateElementParameterToFamilyParameter(i, j)
				error_report = "No errors"
				
			except:
				error_report = "can't assign parameter"
		TransactionManager.Instance.TransactionTaskDone()


OUT = elements,error_report
# ----------------------------------------
flatten_5 = List.Flatten(list=code_block_22.out0)  # frozen
scale_6 = Vector.Scale(vector=code_block_9.out1, scale_factor=flatten_5)
add_4 = Point.Add(point=code_block_9.out0, vectorToAdd=scale_6)
code_block_43 = CodeBlock(placement=flatten_5, inner=flatten) { placement-inner; }
code_block_44 = CodeBlock(slope=watch_2, xdist=code_block_43) { (slope*xdist)/100; }
code_block_45 = CodeBlock(elev=code_block_21, ydisp=code_block_44) { elev+ydisp; }
code_block_46 = CodeBlock(placement=add_4, level=code_block_45) { Point.ByCoordinates(placement.X,placement.Y,level); }
byPoint_3 = ReferencePoint.ByPoint(pt=code_block_46)
code_block_47 = CodeBlock { ((12630-11310)..(12960-11310)..30)*1000; }  # frozen
python_script_4 = Python(IN[0]=transpose_3, IN[1]=code_block_47)  # same code as python_script
code_block_48 = CodeBlock(a=code_block_47) { a+11310; }
scale_7 = Vector.Scale(vector=code_block_9.out1, scale_factor=code_block_19@L1)
